# Grasshopper definition Bookshelf.gh (Grasshopper 1.0.8)

# ---- group: PB:IN
width = Slider(90, range=40..200)
shelves = Slider(5, range=2..8)
finish = Finish({"Oak": "OAK", "Walnut": "WALNUT", "White lacquer": "WHITE"}, selected="Oak")

# ---- group: Fixed sizes (not parameters)
depth = Slider(30, range=20..60)
# META: name: Bookshelf
# id: 2f8d0c1a-7b3e-4e5f-9a1b-6c4d2e8f0a11
# version: 1
# units: cm
# description: Wall bookshelf sized by width and number of shelves
# origin: back-left corner in plan, at floor level; the front faces +Y
shelf_pitch = Slider(35, range=25..50)

# ---- group: Board thickness by finish
finishes = Panel("""OAK
WALNUT
WHITE""")
thickness = Panel("""2.5
2.5
1.8""")
mindex = MemberIndex(Set=finishes, Member=finish)  # -> Index, Count
item = ListItem(List=thickness, Index=mindex.Index, Wrap=True)
t = BoardThickness(item)

# ---- group: Shelf levels
series = Series(Start=0, Step=shelf_pitch, Count=shelves)

# ---- group: Shelves
subtraction = Subtraction(A=width, B=t)
addition = Addition(A=series, B=t)
pt = ConstructPoint(XCoordinate=t, YCoordinate=0, ZCoordinate=series)
pt_2 = ConstructPoint(XCoordinate=subtraction, YCoordinate=depth, ZCoordinate=addition)
box = Box2Pt(PointA=pt, PointB=pt_2, Plane=PlaneXY(0, 0, 0))

# ---- group: Sides
item_2 = ListItem(List=series, Index=-1, Wrap=True)
addition_2 = Addition(A=item_2, B=t)
height = Height(addition_2)
pt_3 = ConstructPoint(XCoordinate=0, YCoordinate=0, ZCoordinate=0)
pt_4 = ConstructPoint(XCoordinate=t, YCoordinate=depth, ZCoordinate=height)
box_2 = Box2Pt(PointA=pt_3, PointB=pt_4, Plane=PlaneXY(0, 0, 0))
X = UnitX(Factor=subtraction)
move = Move(Geometry=box_2, Motion=X)  # -> Geometry, Transform

# ---- group: Messages
height_text = Panel("Height {0} cm")
limit = Panel("100")
warning_text = Panel("WARN: wider than 100 cm: the shelves will sag")
format = Format(Format=height_text, Culture=127, Data0=height)
larger = LargerThan(FirstNumber=width, SecondNumber=limit)  # -> LargerThan, OrEqualTo
dispatch = Dispatch(List=warning_text, DispatchPattern=larger.LargerThan)  # -> ListA, ListB

# ---- group: Plan outline
rectangle = Rectangle(Plane=PlaneXY(0, 0, 0), XSize=width, YSize=depth, Radius=0)  # -> Rectangle, Length

# ---- group: PB:OUT
body = Body([box, box_2, move.Geometry])
plan_outline = PlanOutline(rectangle.Rectangle)
messages = Messages([format, dispatch.ListA])

# ----
messages_shown = Panel(messages)
